# Dynamo graph ImportFromXframe3D.dyn (Dynamo 1.3.1.1736)

file_path = Filename("Examples\staal_edit.xml")
xframe3DImportXML = Custom[Xframe3DImportXML](xmlFile=file_path)  # Import Xframe3D XML and convert to points, lines and metadata

# group: PROJECTINFORMATION
watch = Watch(xframe3DImportXML.projectInformation)

# group: CREATE GRIDS
byLine = Grid.ByLine(xframe3DImportXML.gridXline)
code_block = CodeBlock { "Name"; }
setParameterByName = Element.SetParameterByName(element=byLine, parameterName=code_block, value=xframe3DImportXML.gridXLable)
byLine_2 = Grid.ByLine(xframe3DImportXML.gridYline)
setParameterByName_2 = Element.SetParameterByName(element=byLine_2, parameterName=code_block, value=xframe3DImportXML.gridYLable)

# group: CREATE BEAMS
byStartPointEndPoint = Line.ByStartPointEndPoint(startPoint=xframe3DImportXML.beamFromNodeNumber, endPoint=xframe3DImportXML.beamToNodeNumber)
levels = Levels("00_begane grond")
family_types = FamilyTypes("28_SF_HEA:HEA 180")
beamByCurve = StructuralFraming.BeamByCurve(curve=byStartPointEndPoint, level=levels, structuralFramingType=family_types)
byTwoPoints = Vector.ByTwoPoints(start=xframe3DImportXML.beamFromNodeNumber, end=xframe3DImportXML.beamToNodeNumber)
ZAxis = Vector.ZAxis()
isParallel = Vector.IsParallel(byTwoPoints, ZAxis)
filterByBoolMask = List.FilterByBoolMask(list=byStartPointEndPoint, mask=isParallel)
filterByBoolMask_2 = List.FilterByBoolMask(list=xframe3DImportXML.beamProfileName, mask=isParallel)
